# Dynamo graph Dyn tutorial.dyn (Dynamo 2.5.0.7460)

# group: String.Concat
# note: Ví dụ về String.Concat - dùng để kết hợp nhiều string thành một
code_block = CodeBlock { 1..10; }
string_from_object = FromObject(obj=code_block)
string = StringInput("Hello")
string_2 = StringInput("World")
list_create = List.Create(item0=string, item1=string_2)
concat = String.Concat(string0=string_from_object, string1=list_create)

# group: String.Join
# note: Ví dụ về String.Join trong trường hợp  2 chuỗi viết liền thay vào đó có thể sử dụng String.Join
string_3 = StringInput(".")
string_4 = StringInput("Hello")
string_5 = StringInput("World")
# note: Note:
# - Separator phải hợp lệ. Dùng các ký tự tách như ","  "-" ...
# - String phải là danh sách - Không nhận chuỗi đơn lẻ.
# - Số phải chuyển thành chuỗi trước khi đưa vào ( Có thể dùng StringFromObject như bên trên ).
# - Xử lý danh sách lồng nhau - nested lists (Sử dụng List.Flatten trước khi nối).
join = String.Join(separator=string_3, string0=string_4, string1=string_5)

# group: String from Array
# note: String from Array sử dụng để chuyển 1 dánh sách String thành 1 chuỗi String duy nhất
code_block_2 = CodeBlock { 1..10; }
# note: Note:
# - Không tự động thêm dấu phân cách, các phần tử bị ghép liền nhau.
# - Không nhận giá trị đơn lẻ.
# - Có thể bị lỗi khi dùng Nested Lists.
# - Số cần được chuyển thành chuỗi (sử dụng String from Object).
string_from_array = FromArray(arr=code_block_2)

# group: String from Object
code_block_3 = CodeBlock { 1..10; }
# note: Note:
# - Chuyển đổi moi dữ liệu thành chuỗi (Số, danh sách, boolean, đối tượng revit có thể chuyển thành chuỗi )
# - Danh sách nối liền nhau("1234.." hay"1,2,3,4,...")
# - Đối tượng revit có thể không hiển thị đúng thông tin(kết quả chỉ có thể trả về là       ID        hoặc        tên kiểu đối tượng      -    dùng Element.GetParameterValueByName để lấy dữ liệu cụ thể).
# - Không thể định dạng số hoặc chuỗi đầu ra (là những số không tự động làm tròn hoặc thêm định dạng    -     có thể dùng String.Format("{0:0.00}",List) để định dạng số)
# - Nếu đầu vào là null, có thể trả về chuỗi rỗng (Kiểm tra trước với Objcet.IsNull)
string_from_object_2 = FromObject(obj=code_block_3)

# note: Nested Lists
# 🔹 Tại sao cần Nested Lists trong Dynamo?
# - Giúp quản lý dữ liệu có cấu trúc phức tạp, như danh sách các điểm trong nhiều đường, danh sách các tường trong nhiều cấp, v.v.
# - Hỗ trợ lặp qua từng nhóm dữ liệu một cách hiệu quả.
# - Giúp thao tác với dữ liệu dễ dàng hơn trong các thuật toán thiết kế tham số.
# 🔹 Cách làm việc với Nested Lists trong Dynamo
# - Tạo Nested Lists
# - Dùng List.Create để tạo danh sách chính.
# - Dùng List.AddItemToEnd hoặc List.AddItemToFront để thêm danh sách con vào danh sách chính.
# - Hoặc dùng List.GroupByKey để nhóm các phần tử lại thành danh sách con.
# - Truy cập phần tử trong Nested Lists
# - Dùng List.GetItemAtIndex để lấy danh sách con theo chỉ mục.
# - Dùng List.Flatten để chuyển danh sách lồng nhau thành danh sách phẳng.
# - Duyệt qua Nested Lists
# - Dùng List.Map hoặc List.Combine để áp dụng một hàm lên từng danh sách con.
# - Dùng Lacing (Shortest, Longest, Cross Product) để kiểm soát cách Dynamo lặp qua danh sách.
# 🔹 Ví dụ thực tế trong Revit
# - Lấy danh sách các tường theo từng cấp độ (Level).
# - Nhóm các cột theo từng Grid.
# - Tạo lưới điểm cho các mô hình tham số.
# note: Ứng dụng thực tế
# - Tìm vị trí của dấu phân cách trong dữ liệu nhập vào (VD: dấu -, _ hoặc .).
# - Xác định số lần xuất hiện của một ký tự hoặc từ trong một chuỗi.
# - Xử lý và chuẩn hóa dữ liệu từ Revit bằng cách tách thông tin dựa vào vị trí ký tự.
string_6 = StringInput("4")
# note: Tìm vị trí chuỗi con trong một chuỗi chính
allIndicesOf = String.AllIndicesOf(str=string_from_object_2, searchFor=string_6)
# note: Ứng dụng thực tế
# - Kiểm tra dữ liệu nhập vào có chứa một phần cụ thể không (VD: mã số, loại vật liệu, tên family…).
# - Lọc danh sách đối tượng Revit dựa trên tên hoặc thông tin.
# - Xác định xem một file có phải định dạng .rvt, .dwg, .ifc không.
# Tạo điều kiện rẽ nhánh trong Dynamo dựa trên nội dung chuỗi.
string_7 = StringInput("4")
# note: Kiểm tra chuỗi có chứa một chuỗi con hay không
contains = String.Contains(str=string_from_object_2, searchFor=string_7)
string_8 = StringInput("12135465678978")
string_from_object_3 = FromObject(obj=string_8)
# note: Ứng dụng thực tế
# - Đếm số lần xuất hiện của một mã định danh hoặc ký tự đặc biệt trong dữ liệu.
# - Kiểm tra xem một từ khóa quan trọng có lặp lại nhiều lần trong một chuỗi không.
# - Phân tích dữ liệu văn bản trong Revit để lọc và xử lý thông tin.
# - Xác định xem một đường dẫn hay tên file có chứa dấu phân tách (,, -, _, .) bao nhiêu lần.
string_9 = StringInput("7")
# note: Đếm số lượng lặp lại của một chuỗi con trong chuỗi chính
countOccurrences = String.CountOccurrences(str=string_from_object_3, searchFor=string_9)
string_10 = StringInput("12135465678978")
string_from_object_4 = FromObject(obj=string_10)
# note: Ứng dụng thực tế
# - Kiểm tra đuôi tên file trong Dynamo (VD: .rvt, .dwg, .ifc).
# - Xác định các danh mục hoặc loại
# phần tử dựa trên quy ước đặt tên.
# - Lọc danh sách phòng hoặc khu vực theo ký hiệu cuối cùng (VD: "A", "B").
# - Tạo điều kiện trong Dynamo để tự động chọn các đối tượng phù hợp.
string_11 = StringInput("8")
# note: Kiểm tra xem một chuỗi có kết thúc bằng một chuỗi con cụ thể hay không
endsWith = String.EndsWith(str=string_from_object_4, searchFor=string_11)
string_12 = StringInput("12135465678978")
string_from_object_5 = FromObject(obj=string_12)
# note: Ứng dụng thực tế
# - Tìm vị trí của dấu phân cách (-, _, .) trong tên file hoặc mã số.
# - Xác định vị trí của một từ khóa trong mô tả hoặc thông tin tham số của đối tượng.
# - Làm sạch và chuẩn hóa dữ liệu bằng cách xác định vị trí các ký tự cần thay đổi.
# - Cắt chuỗi bằng cách kết hợp với Substring, dựa vào vị trí tìm thấy.
string_13 = StringInput("7")
# note: Tìm vị trí xuất hiện đầu tiên của sub-string inside a string
indexOf = String.IndexOf(str=string_from_object_5, searchFor=string_13)
string_14 = StringInput("12135465678978")
string_from_object_6 = FromObject(obj=string_14)
# note: Ứng dụng thực tế
# - Tìm vị trí của dấu phân cách cuối cùng (-, _, .) trong tên file hoặc mã số.
# - Xác định vị trí của phần mở rộng file bằng cách tìm dấu "." cuối cùng.
# - Cắt chuỗi từ cuối bằng cách kết hợp với Substring, dựa trên vị trí tìm thấy.
# - Tìm phần tử quan trọng nhất trong dữ liệu có lặp lại.
string_15 = StringInput("7")
# note: Tìm vị trí xuất hiện cuối cùng của sub-string inside a string
lastIndexOf = String.LastIndexOf(str=string_from_object_6, searchFor=string_15)
string_16 = StringInput("12135465678978")
# note: Ứng dụng thực tế
# - Xác định độ dài của mã số hoặc tên đối tượng để kiểm tra tính hợp lệ.
# - Kiểm tra dữ liệu nhập vào (VD: mã vật liệu phải có đúng 8 ký tự).
# - Tạo điều kiện lọc dữ liệu dựa trên độ dài của chuỗi.
# - Làm sạch dữ liệu bằng cách phát hiện chuỗi rỗng hoặc chuỗi quá ngắn.
string_from_object_7 = FromObject(obj=string_16)
# note: Xác định độ dài của chuỗi
length = String.Length(str=string_from_object_7)
string_17 = StringInput("12135465678978")
string_from_object_8 = FromObject(obj=string_17)
# note: Ứng dụng thực tế
# - Kiểm tra mã số vật liệu, phòng, tầng có đúng quy tắc đặt tên không.
# - Lọc danh sách Family theo tiền tố (prefix) như "WALL_", "DOOR_".
# - Kiểm tra các file có đúng định dạng yêu cầu không (VD: "REVIT_", "BIM_").
# - Tạo điều kiện tự động xử lý dữ liệu dựa trên quy tắc đặt tên.
string_18 = StringInput("1")
# note: Kiểm tra chuỗi có bắt đầu bằng một chuỗi con cụ thể không
startsWith = String.StartsWith(str=string_from_object_8, searchFor=string_18)
string_19 = StringInput("Hello")
code_block_4 = CodeBlock { 13; }
# note: Ứng dụng thực tế
# - Định dạng văn bản đầu ra để tạo báo cáo dễ đọc.
# - Căn chỉnh tên hoặc mã số trong danh sách khi xuất ra file Excel hoặc bảng thông tin.
# - Tạo tiêu đề hoặc nhãn trong Dynamo UI một cách cân đối.
# - Điều chỉnh dữ liệu xuất ra để in ấn hoặc trình bày.
string_20 = StringInput("-")
# note: Dùng để tăng độ dài nhất định, giữ nguyên ký tự gốc và thêm khoản trống ở 2 bên
center = String.Center(str=string_19, newWidth=code_block_4, padChars=string_20)
number_slider = DoubleSlider(13, range=0..20 step 1)
string_21 = StringInput("diem dang long")
boolean = BoolSelector(false)
# note: Sử dụng chuyển đổi kiểu chuỗi
changeCase = String.ChangeCase(str=string_21, upper=boolean)
string_22 = StringInput("tầng 1")
code_block_5 = CodeBlock { 0; }
# note: Ứng dụng thực tế
# - Chỉnh sửa mã phòng, mã vật liệu bằng cách thêm ký tự phân cách (-, _).
# - Thêm tiền tố hoặc hậu tố vào tên Family, View, hoặc Sheet trong Revit.
# - Định dạng lại dữ liệu xuất ra từ Revit để phù hợp với tiêu chuẩn công ty.
# - Tự động điều chỉnh tên file khi xuất ra từ Dynamo.
string_23 = StringInput("Mặt bằng ")
# note: Dùng để chèn một chuỗi con vào vị trí xác định trong chuỗi
insert = String.Insert(str=string_22, index=code_block_5, toInsert=string_23)
# note: Tăng độ dài của chuỗi nhất định, chèn ký tự vào bên trái của chuỗi
padLeft = String.PadLeft()  # unwired: str, newWidth
# note: Tăng độ dài của chuỗi nhất định, chèn ký tự vào bên phải của chuỗi
padRight = String.PadRight()  # unwired: str, newWidth
string_24 = StringInput("Diem Dang Long dang hoc Dynamo")
code_block_6 = CodeBlock { 9; }
# note: Ứng dụng thực tế
# - Xóa phần mở rộng file (VD: ".rvt", ".dwg", ".ifc").
# - Loại bỏ mã ký hiệu hoặc tiền tố/hậu tố không cần thiết trong tên Family, View, hoặc Sheet.
# - Xóa các ký tự dư thừa trong dữ liệu nhập từ Excel vào Revit.
# - Tạo tiêu chuẩn đặt tên bằng cách loại bỏ phần không mong muốn trong chuỗi.
code_block_7 = CodeBlock { 5; }
# note: Xóa một phần từ của chuỗi trên vị trí  và số lượng cần xóa
remove = String.Remove(str=string_24, startIndex=code_block_6, count=code_block_7)
string_25 = StringInput("E:\Home\00.BIM SPEC\K009-Lập trình C#\DOC\WIP\BUOI 05_2002")
# note: Ứng dụng thực tế
# - Tách mã số phòng, tầng, vật liệu để xử lý riêng từng phần.
# - Làm sạch dữ liệu nhập từ Excel trước khi nhập vào Revit.
# - Phân tích tên Family, View, Sheet bằng cách chia nhỏ các thành phần.
# - Tách dữ liệu xuất ra CSV hoặc JSON để sử dụng trong các phần mềm khác
string_26 = StringInput("\")
# note: Tách một chuỗi thành danh sách các chuỗi con theo separator
split = String.Split(str=string_25, separator0=string_26)
string_27 = StringInput("Diem Dang Long dang hoc Dynamo")
string_28 = StringInput("dang hoc Dynamo")
string_29 = StringInput("chuẩn bị xin vào HC technologies nè")
# note: Thay đổi chuỗi con trong chuỗi chính bằng chuỗi con khác
replace = String.Replace(str=string_27, searchFor=string_28, replaceWith=string_29)
string_30 = StringInput("chuẩn")
# note: Ứng dụng thực tế
# - Trích xuất mã số từ tên đối tượng Revit (Family, View, Sheet).
# - Lấy phần đầu hoặc cuối của chuỗi để chuẩn hóa dữ liệu.
# - Xử lý tên file, mã vật liệu, số phòng để sử dụng trong Dynamo workflows.
# - Cắt chuỗi theo quy tắc đặt tên trong mô hình BIM.
allIndicesOf_2 = String.AllIndicesOf(str=replace, searchFor=string_30)
number_slider_2 = DoubleSlider(35, range=0..100 step 1)
substring = String.Substring(str=replace, startIndex=allIndicesOf_2, length=number_slider_2)
# note: Ứng dụng thực tế
# - Chuyển đổi dữ liệu nhập từ Excel sang dạng số để tính toán trong Dynamo.
# - Trích xuất số từ tên Family, View, Sheet để dùng trong sắp xếp hoặc gán thông tin.
# - Xử lý thông tin số liệu trong thông số (Parameter) của Revit.
# - Tạo các công thức tính toán động trong Dynamo bằng cách lấy giá trị số từ Text.
toNumber = String.ToNumber()  # unwired: str
string_31 = StringInput("a")
code_block_8 = CodeBlock { 12; }
# note: Trích xuất ngược ra danh sách Keys và Values
byKeysValues = DesignScript.Builtin.Dictionary.ByKeysValues(keys=string_31, values=code_block_8)
components = DesignScript.Builtin.Dictionary.Components(dictionary=byKeysValues)
string_32 = StringInput("a")
string_33 = StringInput("b")
code_block_9 = CodeBlock(a=string_32, b=string_33) { [a,b]; }
# note: Ứng dụng thực tế
# - Tạo bảng tra cứu thông tin vật liệu, phòng, loại Family.
# - Tự động gán giá trị vào Parameter của đối tượng Revit dựa trên Dictionary.
# - Làm sạch dữ liệu nhập từ Excel hoặc JSON và chuyển đổi thành Dictionary.
# - Dễ dàng truy xuất thông tin mà không cần xử lý danh sách thủ công.
code_block_10 = CodeBlock { [1,2]; }
# note: Sử dụng để tạo một Dictionary từ 2 danh sách Keys, Values
byKeysValues_2 = DesignScript.Builtin.Dictionary.ByKeysValues(keys=code_block_9, values=code_block_10)
# note: Ứng dụng thực tế
# - Truy xuất nhanh dữ liệu vật liệu, thông tin phòng, danh sách đối tượng trong Revit.
# - Lấy giá trị thông số từ Dictionary để gán vào các Parameter trong Revit.
# - Tạo bảng tra cứu để lấy dữ liệu nhanh chóng từ các tập hợp thông tin lớn.
# - Tối ưu hóa xử lý dữ liệu bằng cách trích xuất thông tin một cách linh hoạt
string_34 = StringInput("b")
# note: Ứng dụng thực tế
# - Xóa các vật liệu không còn sử dụng trong danh sách vật liệu của dự án.
# - Loại bỏ các phòng không cần thiết khỏi danh sách quản lý trong Dynamo.
# - Làm sạch dữ liệu trước khi xuất ra Excel hoặc JSON.
# - Cập nhật danh sách thông số Revit bằng cách loại bỏ các mục không cần thiết.
# note: Truy xuất giá trị tương ứng với một hoặc nhiều keys trong Dictionary
valueAtKey = DesignScript.Builtin.Dictionary.ValueAtKey(dictionary=byKeysValues_2, key=string_34)
list_create_2 = List.Create(item0=byKeysValues_2, item1=byKeysValues)
string_35 = StringInput("b")
removeKeys = DesignScript.Builtin.Dictionary.RemoveKeys(dictionary=list_create_2, keys=string_35)
# note: Ứng dụng thực tế
# - Cập nhật thông tin vật liệu trong Dynamo mà không cần tạo lại danh sách từ đầu.
# - Điều chỉnh dữ liệu phòng, sheet, view trong Revit bằng cách thay đổi thông số qua Dictionary.
# - Thêm mới hoặc sửa đổi dữ liệu tự động từ Excel trước khi nhập vào Revit.
# - Làm sạch và cập nhật thông tin trước khi xuất ra bảng thống kê.
# note: Sử dụng đếm số lượng cặp khá giá trị (key- value) trong một Dictionary
# note: Ứng dụng thực tế
# - Kiểm tra số lượng phần tử trong Dictionary để tránh lỗi xử lý dữ liệu.
# - Thống kê số lượng vật liệu, phòng, hoặc loại đối tượng trong Revit.
# - Làm việc với dữ liệu nhập từ Excel, JSON để xác nhận số lượng thông tin.
# - Kiểm tra danh sách thông số của Family trong Revit để đảm bảo đầy đủ dữ liệu.
count = DesignScript.Builtin.Dictionary.Count(dictionary=removeKeys)
string_36 = StringInput("c")
code_block_11 = CodeBlock { 14; }
# note: Cập nhật thêm/thay đổi mới các giá trị vào Dictionary dựa vào Keys
setValueAtKeys = DesignScript.Builtin.Dictionary.SetValueAtKeys(dictionary=removeKeys, keys=string_36, values=code_block_11)
keys = DesignScript.Builtin.Dictionary.Keys(dictionary=setValueAtKeys)
values = DesignScript.Builtin.Dictionary.Values(dictionary=setValueAtKeys)
# note: Tạo một danh sách từ nhiều giá trị đầu vào
list_create_3 = List.Create()  # unwired: item0
code_block_12 = CodeBlock { 1..10..2; }
code_block_13 = CodeBlock { 1; }
code_block_14 = CodeBlock { 10; }
code_block_15 = CodeBlock { 2; }
# note: Tạo một danh sách số theo một khoảng cách giá trị xác định
range = Range(start=code_block_13, end=code_block_14, step=code_block_15)
# note: Ứng dụng thực tế
# - Tạo danh sách tổ hợp vị trí lưới, trục trong Revit.
# - Sinh tổ hợp vật liệu, cấu kiện để kiểm tra tất cả các phương án thiết kế.
# - Lập danh sách nhóm bộ phận hoặc nhóm đối tượng trong thiết kế kiến trúc/kết cấu.
# - Tạo tổ hợp màu sắc, kiểu dáng trong Family hoặc Dynamo Geometry.
code_block_16 = CodeBlock { 2; }
# note: Tạo tất cả cá tổ hợp có thể có từ một danh sách phần từ đầu vào
# note: So sánh Combinations vs Permutations:
# - Combinations khi bạn chỉ quan tâm đến nhóm phần tử, không cần xét đến thứ tự - Không nhận các danh sách lặp lại khác thứ tự.
# - Permutations khi thứ tự phần tử quan trọng - Nhận các danh sách lặp lại khác thứ tự.
combinations = List.Combinations(list=range, length=code_block_16)
code_block_17 = CodeBlock { 1; }
code_block_18 = CodeBlock { 10; }
code_block_19 = CodeBlock { 2; }
# note: Tạo một danh sách ố theo quy luật xác định, với số lượng phần tử cụ thể
sequence = Sequence(start=code_block_17, amount=code_block_18, step=code_block_19)
# note: Ứng dụng thực tế
# - Tạo mô hình dạng lặp lại trong thiết kế (ví dụ: mô hình tấm lưới, cấu trúc lặp).
# - Lặp lại danh sách vật liệu, kiểu kết cấu, hoặc kiểu mặt bằng trong Revit.
# - Tạo danh sách nhãn, kiểu chữ hoặc mẫu màu theo chu kỳ nhất định.
# - Sử dụng trong hình học parametric để tạo các mẫu có tính lặp.
code_block_20 = CodeBlock { 2; }
# note: Lặp lại một danh sách các phần tử theo số lần chỉ định
cycle = List.Cycle(list=sequence, amount=code_block_20)
# note: Ứng dụng thực tế
# - Tạo chuỗi dữ liệu từ danh sách thông tin trong Dynamo (ví dụ: danh sách phòng, danh sách vật liệu).
# - Xuất danh sách số hoặc tên thành một chuỗi dễ đọc để nhập vào bảng thông số Revit.
# - Tạo nhãn (tag) tự động trong Revit bằng cách nối dữ liệu thuộc tính.
# - Xử lý dữ liệu trước khi xuất sang Excel hoặc JSON.
join_2 = List.Join(list0=range, list1=sequence)
string_37 = StringInput("Hello")
# note: Ứng dụng thực tế
# - Tạo danh sách giá trị mặc định trong Dynamo.
# - Tạo danh sách chứa các phần tử giống nhau để nhập vào Revit (ví dụ: vật liệu, loại tường, thông số mặc định).
# - Sử dụng trong thiết lập tham số hàng loạt (ví dụ: đặt giá trị giống nhau cho nhiều đối tượng).
# - Kết hợp với các node khác để tạo mô hình lặp lại có quy luật trong Revit.
code_block_21 = CodeBlock { 3; }
ofRepeatedItem = List.OfRepeatedItem(item=string_37, amount=code_block_21)
# note: Ứng dụng thực tế
# - Tạo danh sách thứ tự khác nhau của các thành phần trong thiết kế.
# - Sinh tất cả các khả năng sắp xếp đối tượng trong mô hình Revit.
# - Lập danh sách tất cả các cách xếp đặt vật liệu, kết cấu theo mọi thứ tự có thể.
# - Dùng trong tối ưu hóa thiết kế với nhiều phương án hoán vị khác nhau.
code_block_22 = CodeBlock { 2; }
permutations = List.Permutations(list=range, length=code_block_22)
# note: Tạo một danh sách rỗng hoặc kiểm tra một danh sách có rỗng không.
empty = List.Empty()
boolean_2 = BoolSelector(false)
boolean_3 = BoolSelector(false)
boolean_4 = BoolSelector(false)
list_create_4 = List.Create(item0=boolean_2, item1=boolean_3, item2=boolean_4)
allFalse = List.AllFalse(list=list_create_4)
boolean_5 = BoolSelector(false)
boolean_6 = BoolSelector(true)
# note: - Kiểm tra trạng thái kiểm tra lỗi trong thiết kế (nếu không có lỗi nào, danh sách kết quả sẽ toàn false).
# - Lọc danh sách dữ liệu Boolean để kiểm tra điều kiện tổng thể.
# - Xác nhận rằng không có điều kiện nào được thỏa mãn trước khi thực hiện một hành động nào đó.
boolean_7 = BoolSelector(false)
list_create_5 = List.Create(item0=boolean_5, item1=boolean_6, item2=boolean_7)
allFalse_2 = List.AllFalse(list=list_create_5)
code_block_23 = CodeBlock { [10,20,30,20,50,60,20,50,80]; }
# note: Ứng dụng thực tế trong Dynamo & Revit
# - Xác định vị trí của một phần tử trong danh sách dữ liệu.
# - Lọc và tìm tất cả các đối tượng có thuộc tính cụ thể trong danh sách dữ liệu lấy từ Revit.
# - Tìm các phần tử trùng lặp trong danh sách và lấy vị trí của chúng.
code_block_24 = CodeBlock { 20; }
# note: Tìm tất cả các vị trí (chỉ mục - index) của một giá trị cụ thể trong danh sách
allIndicesOf_3 = List.AllIndicesOf(list=code_block_23, item=code_block_24)
allTrue = List.AllTrue()  # unwired: list
code_block_25 = CodeBlock { [10,20,30,20,50,60,20,50,80]; }
code_block_26 = CodeBlock { 20; }
# note: Kiểm tra danh sách có đối tượng đó ko
contains_2 = List.Contains(list=code_block_25, item=code_block_26)
code_block_27 = CodeBlock { [10,20,30,20,50,60,20,50,80]; }
count_2 = List.Count(list=code_block_27)
# note: - Đếm số lượng phần tử trong danh sách đối tượng Revit (ví dụ: số lượng cửa, cột, dầm, v.v.).
# - Kiểm tra danh sách có đủ phần tử trước khi thực hiện các thao tác tiếp theo.
# - Lọc và thống kê dữ liệu từ danh sách trong Dynamo.
boolean_8 = BoolSelector(false)
boolean_9 = BoolSelector(false)
boolean_10 = BoolSelector(false)
boolean_11 = BoolSelector(true)
# note: - Kiểm tra số lượng lỗi hoặc điều kiện không thỏa mãn trong danh sách kiểm tra thiết kế.
# - Lọc và thống kê số lượng đối tượng không đạt yêu cầu.
# - Phân tích dữ liệu Boolean từ danh sách kiểm tra trạng thái trong Revit.
boolean_12 = BoolSelector(true)
boolean_13 = BoolSelector(false)
list_create_6 = List.Create(item0=boolean_8, item1=boolean_9, item2=boolean_10, item3=boolean_11, item4=boolean_12, item5=boolean_13)
countFalse = List.CountFalse(list=list_create_6)
countTrue = List.CountTrue(list=list_create_6)
code_block_28 = CodeBlock { 1..10; }
code_block_29 = CodeBlock { 3; }
diagonalLeft = List.DiagonalLeft(list=code_block_28, rowLength=code_block_29)
diagonalRight = List.DiagonalRight(list=code_block_28, subLength=code_block_29)
code_block_30 = CodeBlock { 1..10; }
code_block_31 = CodeBlock { 1..10..2; }
equals = List.Equals(objectA=code_block_30, objectB=code_block_31)
# note: - Lọc và lấy dữ liệu theo đường chéo chính của ma trận dữ liệu (bảng, danh sách 2D).
# - Xử lý ma trận thông tin, chẳng hạn như tọa độ điểm, lưới kết cấu, hoặc thông số Revit.
# - Áp dụng cho bài toán hình học hoặc tính toán dữ liệu dạng ma trận trong Dynamo.
code_block_32 = CodeBlock { 1..10..#5; }
code_block_33 = CodeBlock { 5.5; }
firstIndexOf = List.FirstIndexOf(list=code_block_32, item=code_block_33)
code_block_34 = CodeBlock { 1..10..#5; }
firstItem = List.FirstItem(list=code_block_34)
code_block_35 = CodeBlock { 2; }
getItemAtIndex = List.GetItemAtIndex(list=code_block_34, index=code_block_35)
code_block_36 = CodeBlock { 5.5; }
indexOf_2 = List.IndexOf(list=code_block_34, element=code_block_36)
isEmpty = List.IsEmpty(list=code_block_34)
# note: Kiểm tra xem các phần tử có cùng kiểu dữ liệu ko
isHomogeneous = List.IsHomogeneous(list=code_block_34)
code_block_37 = CodeBlock { a=[1,2,3]; b=[2,5,3]; c=[5,8,6]; }
list_create_7 = List.Create(item0=code_block_37.a, item1=code_block_37.b, item2=code_block_37.c)
isRectangular = List.IsRectangular(list=list_create_7)
lastItem = List.LastItem(list=code_block_34)
maximumItem = List.MaximumItem(list=list_create_7)
minimumItem = List.MinimumItem(list=list_create_7)
code_block_38 = CodeBlock { a=[1,2,3]; b=[2,[5,3]]; c=[5,8,6]; }
list_create_8 = List.Create(item0=code_block_38.a, item1=code_block_38.b, item2=code_block_38.c)
rank = List.Rank(list=list_create_8)
# note: tìm phần tử có trong list A nhưng ko có trong list B
code_block_39 = CodeBlock { a=[1,2,3]; b=[2,5,3]; }
setDifference = List.SetDifference(list1=code_block_39.a, list2=code_block_39.b)
# note: tìm phần tử có trong list A và có trong list B
setIntersection = List.SetIntersection(list1=code_block_39.a, list2=code_block_39.b)
# note: tìm phần tử có trong list A cả có trong list B
setUnion = List.SetUnion(list1=code_block_39.a, list2=code_block_39.b)
code_block_40 = CodeBlock { a=[1,2,3]; b=[2,5,3]; }
trueForAll = List.TrueForAll(list=code_block_40.b)  # unwired: predicate
code_block_41 = CodeBlock { input<2; }  # unwired: input
code_block_42 = CodeBlock { [1,2,5,15,1,1,8,2,15]; }
uniqueItems = List.UniqueItems(list=code_block_42)
# note: So sánh Combinations vs Permutations:
# - Combinations khi bạn chỉ quan tâm đến nhóm phần tử, không cần xét đến thứ tự - Không nhận các danh sách lặp lại khác thứ tự.
# - Permutations khi thứ tự phần tử quan trọng - Nhận các danh sách lặp lại khác thứ tự.
# - CartesianProduct tạo tất cả tổ hợp nhưng ko quan tâm thứ tự .
join_3 = List.Join()  # unwired: list0, list1
code_block_43 = CodeBlock { a=[1,2,3]; b=[2,5,3]; }
cartesianProduct = List.CartesianProduct(comb=join_3, list1=code_block_43.a, list2=code_block_43.b)
code_block_44 = CodeBlock { L1=3.14; L2="Hello World"; L3=true; L4=false; Ltot1=[L1,L2]; Ltot2=[L3,L4]; }
add = _ + _  # unwired: x, y
# note: - Tạo danh sách tọa độ điểm từ các danh sách x, y, z.
# - Kết hợp các thông số (ví dụ: chiều dài, chiều rộng) để tính diện tích.
# - Tự động tạo nhãn hoặc tên theo quy tắc ghép từ nhiều danh sách dữ liệu.
# - Thực hiện phép toán (cộng, trừ, nhân, chia) trên danh sách số liệu Revit.
code_block_45 = CodeBlock { list1=[1,5,9]; list2=[5,9,2]; }
# note: Dùng kết hợp nhiều danh sách với nhau bằng một hàm tùy chỉnh. Giúp có thể áp dụng một hàm lên từng phần tử tương ứng của các danh sách đầu vào
combine = List.Combine(comb=add, list1=code_block_45.list1, list2=code_block_45.list2)
code_block_46 = CodeBlock { list1=[1,5,9]; list2=[5,9,2]; }
# note: Dùng để áp dụng một hàm tùy chỉnh lên từng phần tử của một danh sách.
# note: So sánh Combine vs Map:
# - Combine áp dụng lên từng phần tử tương ứng của nhiều danh sách.
# - Map áp dụng hàm lên từng phần tử của một danh sách.
list_create_9 = List.Create(item0=code_block_46.list1, item1=code_block_46.list2)
# note: - Chuyển đổi danh sách tọa độ thành danh sách điểm.
# - Tạo danh sách tên tự động từ danh sách dữ liệu.
# - Chuyển đổi danh sách thông số Revit (ví dụ: đổi đơn vị mm sang mét).
# - Thực hiện phép toán nhanh trên danh sách số liệu.
code_block_47 = CodeBlock { 2; }
mul = _ * code_block_47  # unwired: x
map = List.Map(list=list_create_9, f_x=mul)
# note: Dùng kết hợp nhiều danh sách có độ dài khác nhau, vs quy tắc lấy phần tử dài nhất làm cơ sở. Khi các danh sách ngắn hơn hết phần tử , chúng sẽ lặp lại giá trị cuối cùng cho đến khi đạt độ dài của danh sách dài nhất.
laceLongest = List.LaceLongest()  # unwired: comb, list1, list2, list3
byStartPointEndPoint = Line.ByStartPointEndPoint(lacing=Longest)  # unwired: startPoint, endPoint
code_block_48 = CodeBlock { 1..12..3; 2..20..3; [20,30]; }
byCoordinates = Point.ByCoordinates(x=code_block_48.out0, lacing=Longest)
byCoordinates_2 = Point.ByCoordinates(z=code_block_48.out2)
byCoordinates_3 = Point.ByCoordinates(y=code_block_48.out1, lacing=Longest)
cartesianProduct_2 = List.CartesianProduct()  # unwired: comb, list1, list2, list3
byThreePoints = Circle.ByThreePoints()  # unwired: p1, p2, p3
laceShortest = List.LaceShortest()  # unwired: comb, list1, list2
map_2 = List.Map()  # unwired: list, f_x
combine_2 = List.Combine()  # unwired: comb, list1, list2, list3
code_block_49 = CodeBlock { 32; }
code_block_50 = CodeBlock { 1..10..#8; }
# note: Thêm một phần tử vào cuối danh sách
addItemToEnd = List.AddItemToEnd(item=code_block_49, list=code_block_50)
# note: Thêm một phần tử vào đầu danh sách
addItemToFront = List.AddItemToFront(item=code_block_49, list=code_block_50)
code_block_51 = CodeBlock { 3; }
chop = List.Chop(list=code_block_50, lengths=code_block_51)
deconstruct = List.Deconstruct(list=code_block_50)
code_block_52 = CodeBlock { 1..10; }
number_slider_3 = DoubleSlider(2, range=0..10 step 1)
# note: Loại bỏ các phần tử ở vị trí là bội số của số nguyên "n"
dropEveryNthItem = List.DropEveryNthItem(list=code_block_52, n=number_slider_3)
code_block_53 = CodeBlock { 1..10; }
code_block_54 = CodeBlock { -3; }
# note: loại bỏ đoạn chuỗi với độ dài muốn
dropItems = List.DropItems(list=code_block_53, amount=code_block_54)
code_block_55 = CodeBlock { 0; -5..5..#11; }
# note: - Lọc các phần tử Revit theo loại (Walls, Doors, Windows...).
# - Tạo danh sách điểm thỏa mãn điều kiện (điểm trên đường thẳng, trong phạm vi nhất định...).
# - Chia danh sách số theo điều kiện (số chẵn/lẻ, lớn hơn/mẻ hơn một giá trị).
# - Lọc ra các phần tử có thông số nhất định (vật liệu, kích thước, diện tích…).
# - Tạo danh sách dữ liệu có điều kiện trước khi xuất sang Excel.
code_block_56 = CodeBlock { 5; }
removeItemAtIndex = List.RemoveItemAtIndex(list=code_block_55.out1, indices=code_block_56)
# note: Lọc danh sách theo điều kiện logic bằng cách phân loại phần tử thành hai nhóm:True & False
gt = code_block_55.out0 > _  # unwired: y
filter = List.Filter(list=removeItemAtIndex, condition=gt)
# note: lọc danh sách dựa trên danh sách giá trị Boolean (True/False). Nó chia danh sách đầu vào thành hai nhóm:
# True (Pass) → Chứa các phần tử tại vị trí có giá trị True.
# False (Fail) → Chứa các phần tử tại vị trí có giá trị False.
code_block_57 = CodeBlock { [1,2,3,4,5,6]; [true,false,true,false,true,false]; }
# note: So sánh Filter & FilterbyBoolMask:
# - Filter Lọc sự trên danh sách Boolean và không yêu cầu mask cùng độ dài vs list.
# - FilterByBoolMask Sử dụng danh sách Boolean để lọc trực tiếp.
filterByBoolMask = List.FilterByBoolMask(list=code_block_57.out0, mask=code_block_57.out1)
code_block_58 = CodeBlock { [1,2,[2,6,8,2,7]]; }
flatten = List.Flatten(list=code_block_58)
insert_2 = List.Insert()  # unwired: list, element, index
